# Grasshopper definition 1.01.gh (Grasshopper 1.0.8)

c_script = CSharpScript()  # -> out, a
# ---------- c_script: C# ----------
// Grasshopper Script Instance
#region Usings
using System;
using System.Linq;
using System.Collections;
using System.Collections.Generic;
using System.Drawing;

using Rhino;
using Rhino.Geometry;

using Grasshopper;
using Grasshopper.Kernel;
using Grasshopper.Kernel.Data;
using Grasshopper.Kernel.Types;
#endregion

public class Script_Instance : GH_ScriptInstance
{
    #region Notes
    /* 
      Members:
        RhinoDoc RhinoDocument
        GH_Document GrasshopperDocument
        IGH_Component Component
        int Iteration

      Methods (Virtual & overridable):
        Print(string text)
        Print(string format, params object[] args)
        Reflect(object obj)
        Reflect(object obj, string method_name)
    */
    #endregion

    private void RunScript(object x, object y, ref object a)
    {
        // Write your logic here
        a = null;
    }
}
# ---------- end c_script ----------
py3 = Python3Script()  # -> out, a
# ---------- py3: Python ----------
"""Grasshopper Script"""
a = 20 + 30
print(a)
# ---------- end py3 ----------
panel = Panel(py3.a)
